# Grasshopper definition vase.gh (Grasshopper 1.0.7)
# plug-ins: Bifocals

# ---- group: RH_IN:count
number_slider = Slider(100, range=50..100)

# ---- group: RH_IN:radius
min = Slider(0, range=0..30)

# ----
# PARAMETRIC HOUSE
unit_z = UnitZ(Factor=1)
max = Slider(40, range=3..40)
range = Range(Domain=Domain(0, 1), Steps=10)
line_sdl = LineSDL(Start=Point(0, 0, 0), Direction=unit_z, Length=number_slider)
graph_mapper = GraphMapper(
    range,
    x0=0,
    x1=1,
    y0=0,
    y1=1,
    amplitude=0.1449275613,
    container_name="Perlin",
    decay=0,
    frequency=0.05804949999,
    x_offset=0.5,
    y_offset=0.5)
construct_domain = ConstructDomain(DomainStart=min, DomainEnd=max)
graph_mapper_2 = GraphMapper(
    graph_mapper,
    x0=0,
    x1=1,
    y0=0,
    y1=1,
    container_name="Bezier",
    cpx=[0, 0.4272779524, 0.407407403, 1],
    cpy=[0, 0, 0.7928571701, 1])
divide_curve = DivideCurve(Curve=line_sdl, Count=10, Kinks=False)  # -> Points, Tangents, Parameters
remap_numbers = RemapNumbers(Value=graph_mapper_2, Source=Domain(0, 1), Target=construct_domain)  # -> Mapped, Clipped
unit_x = UnitX(Factor=remap_numbers.Mapped)
move = Move(Geometry=divide_curve.Points, Motion=unit_x)  # -> Geometry, Transform
interpolate = Interpolate(Vertices=move.Geometry, Degree=3, Periodic=False, KnotStyle=1)  # -> Curve, Length, Domain
revolution = Revolution(Curve=interpolate.Curve, Axis=line_sdl, Domain=Domain(0, 6.283185307))
surface = Surface(revolution)
brep_wireframe = BrepWireframe(Brep=surface, Density=-1)
list_item = ListItem(List=brep_wireframe, Index=0, Wrap=True)  # -> Item, Item1, Item2
loft = Loft(
    Curves=flatten(list_item.Item),
    Options={Adjust=True, Closed=False, LoftEnds=0, LoftSimp=0, LoftType=0, Rebuild=10, Refit=0.01})
loft_2 = Loft(
    Curves=flatten(list_item.Item2),
    Options={Adjust=True, Closed=False, LoftEnds=0, LoftSimp=0, LoftType=0, Rebuild=10, Refit=0.01})
brep_join = BrepJoin(Breps=flatten([revolution, loft, loft_2]))  # -> Breps, Closed

# ---- group: RH_OUT:mesh
mesh = Mesh(brep_join.Breps)

# ----
custom_preview = CustomPreview(Geometry=mesh, Material=ColourSwatch(SwatchColor=RGB(255, 0, 0)))
